# Grasshopper definition Logo.gh (Grasshopper 1.0.5)
# plug-ins: Kangaroo Components, Weaverbird, Kangaroo2 Components, Mesh Pipe

number_slider = Slider(5, range=0..10)
recgrid = Rectangular(
    Plane=PlaneXY(0, 0, 0),
    SizeX=number_slider,
    SizeY=number_slider,
    ExtentX=expr("(x*1.5)-0.5", number_slider),
    ExtentY=expr("x*1.5-0.5", number_slider))  # -> simplify(Cells), Points
split = SplitTree(Data=recgrid.Cells, Masks=flatten("{3}[3]"))  # -> Positive, Negative
explode = Explode(Curve=recgrid.Cells, Recursive=True)  # -> Segments, Vertices
dupln = RemoveDuplicateLines(Lines=flatten(explode.Segments), Tolerance=0.01)
area = Area(Geometry=split.Positive)  # -> Area, Centroid
clean = CleanTree(RemoveNulls=True, RemoveInvalid=True, RemoveEmpty=False, Tree=flatten(area.Centroid))
wbweave = WeaverbirdsMeshFromLinesWeaveBack(Lines=flatten(dupln), MaximumValence=4)
cir = Circle(Plane=clean, Radius=Slider(17, range=0..20))
wbfacepolys = WeaverbirdsFacePolylines(Mesh=wbweave)
wbnaked = WeaverbirdsNakedBoundary(MeshClosedPolylines=wbweave)
divide = DivideCurve(Curve=cir, Count=Slider(29, range=0..100), Kinks=False)  # -> Points, Tangents, Parameters
explode_2 = Explode(Curve=wbnaked, Recursive=True)  # -> Segments, Vertices
explode_3 = Explode(Curve=wbfacepolys, Recursive=True)  # -> Segments, Vertices
len = Length(Curve=explode_3.Segments)
show = Show(G=explode_3.Segments)
multiplication = Multiplication(A=len, B=Slider(0.89, range=0..1))
anchor = Anchor(Point=divide.Points, Target=explode_2.Vertices, Strength=10000)  # disabled
length_line = LengthLine(Line=explode_3.Segments, Length=multiplication, Strength=10)
oncurve = OnCurve(Points=explode_2.Vertices, Curve=cir, Strength=Slider(50, range=0..50))
load = Load(Point=explode_3.Vertices, ForceVector=Vector(0, 0, 1))  # disabled
entwine = Entwine(Branch00=show, Branch01=length_line, Branch02=oncurve, Branch03=load, Branch04=anchor, FlattenInputs=True)
solver = Solver(GoalObjects=entwine, Reset=Button(), Threshold=1e-15, Tolerance=0.01, On=Toggle(True))  # -> I, V, O
bang = ExplodeTree(Data=solver.O)
unflatten = UnflattenTree(Tree=bang, Guide=show)
join = JoinCurves(Curves=unflatten, Preserve=False)
number_slider_2 = Slider(2, range=0..10)
number_slider_3 = Slider(2, range=0..10)
explode_4 = Explode(Curve=join, Recursive=True)  # -> Segments, Vertices
duppt = RemoveDuplicatePts(Points=explode_4.Vertices, Tolerance=0.01)
area_2 = Area(Geometry=join)  # -> Area, Centroid
series = Series(Start=0, Step=number_slider_2, Count=number_slider_3)
series_2 = Series(Start=Slider(1, range=0..1), Step=number_slider_2, Count=number_slider_3)
mpipe = MeshPipe(Curve=explode_4.Segments, Radius=Slider(0.1, range=0..0.1), Accuracy=0.2, Rotation=0, Segments=10, Caps=2)
item = ListItem(List=duppt, Index=series, Wrap=True)  # -> simplify(Item)
item_2 = ListItem(List=duppt, Index=series_2, Wrap=True)  # -> simplify(Item)
preview = CustomPreview(Geometry=mpipe, Material=ColourSwatch(SwatchColor=RGB(0, 0, 0)))
split_2 = SplitList(List=item_2, Index=1)  # -> ListA, ListB
split_3 = SplitList(List=item, Index=1)  # -> ListA, ListB
dist = Distance(PointA=split_3.ListA, PointB=split_3.ListB)
dist_2 = Distance(PointA=split_2.ListA, PointB=split_2.ListB)
ln = Line(StartPoint=split_2.ListA, EndPoint=split_2.ListB)
ln_2 = Line(StartPoint=split_3.ListA, EndPoint=split_3.ListB)
pl = ConstructPlane(Origin=area_2.Centroid, XAxis=ln_2, YAxis=ln)
number_slider_4 = Slider(1.2, range=0..1.2)
division = Division(A=dist, B=2)
division_2 = Division(A=dist_2, B=2)
subtraction = Subtraction(A=division, B=number_slider_4)
subtraction_2 = Subtraction(A=division_2, B=number_slider_4)
ellipse = Ellipse(Plane=pl, Radius1=subtraction, Radius2=subtraction_2)  # -> Ellipse, Focus1, Focus2
